# Grasshopper definition all_25_algorithms_001.gh (Grasshopper 1.0.7)
# plug-ins: Bifocals, Hops

# ----
# linearsearch
number_slider = Slider(5012, range=0..10000)
series = Series(Start=0, Step=1, Count=Slider(10000, range=0..10000))
jitter = Jitter(List=series, Jitter=1, Seed=2)  # -> Values, Indices
linearsearch = Hops(
    Target=number_slider,
    List=jitter.Values,
    CacheResultsInMemory=False,
    CacheSolveResults=False,
    RemoteDefinitionLocation="http://127.0.0.1:5000/linearsearch",
    RemoteSolveVersion=(0, 1, 0),
    ShowInput_Enabled=False,
    ShowInput_Path=False,
    SynchronousSolve=True)
panel = Panel(linearsearch)

# ----
# heapsort
number_slider_2 = Slider(1000, range=0..1000)
series_2 = Series(Start=0, Step=1, Count=number_slider_2)
series_3 = Series(Start=Slider(2000, range=0..2000), Step=1, Count=Slider(1000, range=0..1000))
jitter_2 = Jitter(List=series_2, Jitter=1, Seed=2)  # -> Values, Indices
jitter_3 = Jitter(List=series_3, Jitter=1, Seed=Slider(37, range=0..100))  # -> Values, Indices
heapsort = Hops(
    List1=jitter_2.Values,
    List2=jitter_3.Values,
    CacheResultsInMemory=False,
    CacheSolveResults=False,
    RemoteDefinitionLocation="http://127.0.0.1:5000/heapsort",
    RemoteSolveVersion=(0, 1, 0),
    ShowInput_Enabled=False,
    ShowInput_Path=False,
    SynchronousSolve=True)  # -> List1, List2
panel_2 = Panel(heapsort.List1)
panel_3 = Panel(heapsort.List2)
param_viewer = ParamViewer(panel_2)
param_viewer_2 = ParamViewer(panel_3)

# ----
# insertionsort
# insertionsortadd
number_slider_3 = Slider(1000, range=0..1000)
series_4 = Series(Start=0, Step=1, Count=number_slider_3)
series_5 = Series(Start=0, Step=1, Count=Slider(1000, range=0..1000))
jitter_4 = Jitter(List=series_4, Jitter=1, Seed=2)  # -> Values, Indices
jitter_5 = Jitter(List=series_5, Jitter=1, Seed=2)  # -> Values, Indices
insertionsort = Hops(
    List=jitter_5.Values,
    CacheResultsInMemory=False,
    CacheSolveResults=False,
    RemoteDefinitionLocation="http://127.0.0.1:5000/insertionsort",
    RemoteSolveVersion=(0, 1, 0),
    ShowInput_Enabled=False,
    ShowInput_Path=False,
    SynchronousSolve=True)
insertionsortadd = Hops(
    List=Slider(619, range=0..1000),
    Number=jitter_4.Values,
    CacheResultsInMemory=False,
    CacheSolveResults=False,
    RemoteDefinitionLocation="http://127.0.0.1:5000/insertionsortadd",
    RemoteSolveVersion=(0, 1, 0),
    ShowInput_Enabled=False,
    ShowInput_Path=False,
    SynchronousSolve=True)
panel_4 = Panel(insertionsortadd)
panel_5 = Panel(insertionsort)

# ----
# radixsort2
number_slider_4 = Slider(1000, range=0..1000)
series_6 = Series(Start=0, Step=1, Count=number_slider_4)
jitter_6 = Jitter(List=series_6, Jitter=1, Seed=2)  # -> Values, Indices
radixsort2 = Hops(
    List=jitter_6.Values,
    CacheResultsInMemory=False,
    CacheSolveResults=False,
    RemoteDefinitionLocation="http://127.0.0.1:5000/radixsort2",
    RemoteSolveVersion=(0, 1, 0),
    ShowInput_Enabled=False,
    ShowInput_Path=False,
    SynchronousSolve=True)
panel_6 = Panel(radixsort2)

# ----
# quicksort
number_slider_5 = Slider(1000, range=0..1000)
series_7 = Series(Start=0, Step=1, Count=number_slider_5)
jitter_7 = Jitter(List=series_7, Jitter=1, Seed=2)  # -> Values, Indices
quicksort = Hops(
    List=jitter_7.Values,
    CacheResultsInMemory=False,
    CacheSolveResults=False,
    RemoteDefinitionLocation="http://127.0.0.1:5000/quicksort",
    RemoteSolveVersion=(0, 1, 0),
    ShowInput_Enabled=False,
    ShowInput_Path=False,
    SynchronousSolve=True)
panel_7 = Panel(quicksort)

# ----
# selectionsort
number_slider_6 = Slider(1000, range=0..1000)
series_8 = Series(Start=0, Step=1, Count=number_slider_6)
jitter_8 = Jitter(List=series_8, Jitter=1, Seed=2)  # -> Values, Indices
selectionsort = Hops(
    List=jitter_8.Values,
    CacheResultsInMemory=False,
    CacheSolveResults=False,
    RemoteDefinitionLocation="http://127.0.0.1:5000/selectionsort",
    RemoteSolveVersion=(0, 1, 0),
    ShowInput_Enabled=False,
    ShowInput_Path=False,
    SynchronousSolve=True)
panel_8 = Panel(selectionsort)

# ----
# countingsort2
number_slider_7 = Slider(1000, range=0..1000)
series_9 = Series(Start=0, Step=1, Count=number_slider_7)
jitter_9 = Jitter(List=series_9, Jitter=1, Seed=2)  # -> Values, Indices
countingsort2 = Hops(
    List=jitter_9.Values,
    CacheResultsInMemory=False,
    CacheSolveResults=False,
    RemoteDefinitionLocation="http://127.0.0.1:5000/countingsort2",
    RemoteSolveVersion=(0, 1, 0),
    ShowInput_Enabled=False,
    ShowInput_Path=False,
    SynchronousSolve=True)
panel_9 = Panel(countingsort2)

series_10 = Series(Start=0, Step=1, Count=Slider(1000, range=0..1000))
jitter_10 = Jitter(List=series_10, Jitter=1, Seed=2)  # -> Values, Indices

# ----
# binarysearch
number_slider_8 = Slider(2805, range=0..10000)
series_11 = Series(Start=0, Step=1, Count=Slider(10000, range=0..10000))

jitter_11 = Jitter(List=series_11, Jitter=1, Seed=2)  # -> Values, Indices
binarysearch = Hops(
    Target=number_slider_8,
    List=jitter_11.Values,
    CacheResultsInMemory=False,
    CacheSolveResults=False,
    RemoteDefinitionLocation="http://127.0.0.1:5000/binarysearch",
    RemoteSolveVersion=(0, 1, 0),
    ShowInput_Enabled=False,
    ShowInput_Path=False,
    SynchronousSolve=True)

panel_10 = Panel(binarysearch)

# ----
# depthfirstsearch
number_slider_9 = Slider(2805, range=0..10000)
series_12 = Series(Start=0, Step=1, Count=Slider(10000, range=0..10000))

jitter_12 = Jitter(List=series_12, Jitter=1, Seed=2)  # -> Values, Indices
depthfirstsearch = Hops(
    Target=number_slider_9,
    List=jitter_12.Values,
    CacheResultsInMemory=False,
    CacheSolveResults=False,
    RemoteDefinitionLocation="http://127.0.0.1:5000/depthfirstsearch",
    RemoteSolveVersion=(0, 1, 0),
    ShowInput_Enabled=False,
    ShowInput_Path=False,
    SynchronousSolve=True)

panel_11 = Panel(depthfirstsearch)

# ----
# breadthfirstsearch
number_slider_10 = Slider(2805, range=0..10000)
series_13 = Series(Start=0, Step=1, Count=Slider(10000, range=0..10000))

jitter_13 = Jitter(List=series_13, Jitter=1, Seed=2)  # -> Values, Indices
breadthfirstsearch = Hops(
    Target=number_slider_10,
    List=jitter_13.Values,
    CacheResultsInMemory=False,
    CacheSolveResults=False,
    RemoteDefinitionLocation="http://127.0.0.1:5000/breadthfirstsearch",
    RemoteSolveVersion=(0, 1, 0),
    ShowInput_Enabled=False,
    ShowInput_Path=False,
    SynchronousSolve=True)

panel_12 = Panel(breadthfirstsearch)
